# Dynamo graph DynamoLightScrip01-2.dyn (Dynamo 2.0.2.6826)

categories = Categories(index=252)
all_elements_of_category = ElementsOfCategory(Category=categories)
watch = Watch(all_elements_of_category)

# group: INPUT: LIST IND
number = DoubleInput(0)
getItemAtIndex = List.GetItemAtIndex(list=all_elements_of_category, index=number)

watch_2 = Watch(getItemAtIndex)
parameters = Element.Parameters(element=getItemAtIndex)

# group: DEBUGG
code_block = CodeBlock { ["Lamp"]; }

# group: INPUT: SELECT
select_model_element = DSModelElementSelection()  # 1 picked in the model

# group: INPUT METHOD
use_selection = BoolSelector(true)
use_selection_2 = If(test=use_selection, true=select_model_element, false=getItemAtIndex)

getFamily = FamilyInstance.GetFamily(familyInstance=use_selection_2)
name = FamilyType.Name(familyType=use_selection_2)
byFamilyAndName = FamilyType.ByFamilyAndName(family=getFamily, name=name)
code_block_2 = CodeBlock { ["Emit from Rectangle Width"]; }
getParameterValueByName = Element.GetParameterValueByName(element=byFamilyAndName, parameterName=code_block_2, lacing=CrossProduct)
watch_3 = Watch(getParameterValueByName)
parameters_2 = Element.Parameters(element=byFamilyAndName)
watch_4 = Watch(parameters_2)
watch_5 = Watch(byFamilyAndName)
watch_6 = Watch(select_model_element)
