# Dynamo graph DynamoLightScrip01-3.dyn (Dynamo 2.0.2.6826)

categories = Categories(index=252)
all_elements_of_category = ElementsOfCategory(Category=categories)
watch = Watch(all_elements_of_category)

# group: 2. INPUT: LIST IND
number = DoubleInput(0)
getItemAtIndex = List.GetItemAtIndex(list=all_elements_of_category, index=number)

watch_2 = Watch(getItemAtIndex)
parameters = Element.Parameters(element=getItemAtIndex)

# group: DEBUGG
code_block = CodeBlock { ["Lamp"]; }

# group: 2. INPUT: SELECT
select_model_element = DSModelElementSelection()  # 1 picked in the model

# group: 1. INPUT METHOD
use_selection = BoolSelector(true)
use_selection_2 = If(test=use_selection, true=select_model_element, false=getItemAtIndex)

getFamily = FamilyInstance.GetFamily(familyInstance=use_selection_2)
name = FamilyType.Name(familyType=use_selection_2)
byFamilyAndName = FamilyType.ByFamilyAndName(family=getFamily, name=name)

# group: 3. WRITE
code_block_2 = CodeBlock { ["Emit from Rectangle Width"]; }

parameters_2 = Element.Parameters(element=byFamilyAndName)

# group: SELECT INDEX
integer_slider = IntegerSlider(26, range=0..100 step 1)
getItemAtIndex_2 = List.GetItemAtIndex(list=parameters_2, index=integer_slider)
watch_3 = Watch(parameters_2)

name_2 = Parameter.Name(parameter=getItemAtIndex_2)

# group: 3. MANUAL INPUT
override = BoolSelector(true)
if_ = If(test=override, true=code_block_2, false=name_2)

getParameterValueByName = Element.GetParameterValueByName(element=byFamilyAndName, parameterName=if_, lacing=CrossProduct)

# group: Output
watch_4 = Watch(getParameterValueByName)

watch_5 = Watch(byFamilyAndName)
watch_6 = Watch(select_model_element)
watch_7 = Watch(name_2)
