# Dynamo graph DynamoLightScrip01-4.dyn (Dynamo 2.0.2.6826)

# group: 1. READ ME
# note: Hi, this blue box is a group.
# The notes inside will help you to setup this file.
# Please follow the Headers 2 - 6.
# note: .

# group: 2.2.1 CATEGORY
# note: Select a category using the dropdown menu.
# The categories are revit standard
# note: Default: Lighting Fixtures
categories = Categories(index=252)

# group: Element(s) from selected category
all_elements_of_category = ElementsOfCategory(Category=categories)
list_a_all_elements_of_category = Watch(all_elements_of_category)

# group: 2.2.2 INDEX
# note: Select the element from List A by specifying the Index.
index = DoubleInput(1)

# group: 2.2. LIST
# note: Please enter values for #2.2.1 and #2.2.2 before continuing to #3.
getItemAtIndex = List.GetItemAtIndex(list=all_elements_of_category, index=index)

# group: debug
# note: DO NOT REMOVE.
# To be used.
watch = Watch(getItemAtIndex)
parameters = Element.Parameters(element=getItemAtIndex)

# group: 2.1. SELECTTION
# note: Select an element within Revit.
# Come back to Dynamo once finished.
select_model_element = DSModelElementSelection()  # 1 picked in the model

# group: 2. GET ELEMENT(S)
# note: If True, the user have to select - in Revit - one or multiple element(s).
# note: If False, the user have to select ONE (1) element from a list.
get_element_s_from_selection = BoolSelector(false)
condition = If(test=get_element_s_from_selection, true=select_model_element, false=getItemAtIndex)

# group: Get Family Type
# note: When creating a project, you add parametric building elements to the design.
# Revit classifies elements by categories, families, and types.
# note: READ MORE: http://help.autodesk.com/view/RVT/2014/ENU/?guid=GUID-2480CA33-C0B9-46FD-9BDD-FDE75B513727
getFamily = FamilyInstance.GetFamily(familyInstance=condition)
name = FamilyType.Name(familyType=condition)
byFamilyAndName = FamilyType.ByFamilyAndName(family=getFamily, name=name)

# group: debug
# note: DO NOT REMOVE.
# To be used.
watch_2 = Watch(byFamilyAndName)

# group: NEW VALUE
string = StringInput("")
number_slider = DoubleSlider(2700, range=2000..6000 step 100)

# group: Get Family Type Parameters
# note: NB. There's a difference between Family Paramteres and Family Type paramters.
parameters_2 = Element.Parameters(element=byFamilyAndName)

# group: 3. GET FAMILY TYPE PARAMETER
list_b_family_type_parameters = Watch(parameters_2)
# note: Select the element from List A by specifying the Index.
number = DoubleInput(49)
getItemAtIndex_2 = List.GetItemAtIndex(list=list_b_family_type_parameters, index=number)

# group: Get selected Family Type Parameter
name_2 = Parameter.Name(parameter=getItemAtIndex_2)
getParameterValueByName = Element.GetParameterValueByName(element=byFamilyAndName, parameterName=name_2, lacing=CrossProduct)

firstItem = List.FirstItem(list=getParameterValueByName)
type = Object.Type(obj=firstItem)
string_2 = StringInput("System.Double")
code_block = CodeBlock(a=type, b=string_2) { a==b; }
value = Watch(getParameterValueByName)
is_double = If(test=code_block, false=value)  # unwired: true
watch_3 = Watch(is_double)

# group: DEV
string_3 = StringInput("C:\_DegreeProject-Spring19-AndreWisen\_GitHub\AI281X-DegreeProject\status.txt")
readText = FileSystem.ReadText(file=string_3)
string_4 = StringInput("Revit")

code_block_2 = CodeBlock(fileStr=readText) { fileStr=="Revit"; }

# group: 4. HELPER FILE
# note: Break link to force update.
# 1. Set value to False
# 2. Set value to True (again)
keep_link = BoolSelector(true)
# note: Default: C:\_DegreeProject-Spring19-AndreWisen\_GitHub\AI281X-DegreeProject\dummy.txt
# note: Specify full path to helper file.
# See documentations for more info.
string_5 = StringInput("C:\_DegreeProject-Spring19-AndreWisen\_GitHub\AI281X-DegreeProject\dummy.txt")
string_6 = StringInput("")
if_ = If(test=keep_link, true=string_5, false=string_6)

# group: Get value from file
# note: The Helper File should contian the correct (family type) parameter value.
readText_2 = FileSystem.ReadText(file=if_)

toNumber = String.ToNumber(str=readText_2)
string_from_object = FromObject(obj=getParameterValueByName)

# group: 6. FILE I/O
if_2 = If(test=code_block_2, true=toNumber, false=getParameterValueByName)
setParameterByName = Element.SetParameterByName(element=byFamilyAndName, parameterName=name_2, value=if_2)
# note: Determine if Revit should read or write to the helper file.
# note: If True, Revit reads the value and assigns the new value to the selected Family Type Paramter
# note: If False, Revit writes the current Family Type Paramter value to the Helper FIle.
if_3 = If(test=code_block_2, true=readText_2, false=string_from_object)
writeText = FileSystem.WriteText(filePath=string_5, text=if_3)

string_from_object_2 = FromObject(obj=is_double)

# group: Element(s) from selection
watch_4 = Watch(select_model_element)

# group: Get selected Family Type Parameter
unitType = Parameter.UnitType(parameter=getItemAtIndex_2)
storageType = Parameter.StorageType(parameter=getItemAtIndex_2)
parameterType = Parameter.ParameterType(parameter=getItemAtIndex_2)
group = Parameter.Group(parameter=getItemAtIndex_2)
hasValue = Parameter.HasValue(parameter=getItemAtIndex_2)
id = Parameter.Id(parameter=getItemAtIndex_2)
value_2 = Parameter.Value(parameter=getItemAtIndex_2)

# group: 5. COMPARE
# note: This is the current value assigned to the type parameter
string_7 = StringInput(",")
split = String.Split(str=string_from_object, separater0=string_7)
firstItem_2 = List.FirstItem(list=split)
REVIT = Watch(firstItem_2)
split_2 = String.Split(str=readText_2, separater0=string_7)
firstItem_3 = List.FirstItem(list=split_2)
FILE = Watch(firstItem_3)

# group (continued): DEV
if_4 = If(test=code_block_2, true=readText, false=string_4)
writeText_2 = FileSystem.WriteText(filePath=string_3, text=if_4)

watch_5 = Watch(readText)
