# Dynamo graph apply_collision_to_mesh.dyn (Dynamo 2.0.2.6826)

# group: Depricated
string = StringInput("C:\_DegreeProject-Spring19-AndreWisen\190130 - Revit Collision\ids.csv")
categories = Categories(index=599)
all_elements_of_category = ElementsOfCategory(Category=categories)
name = Element.Name(element=all_elements_of_category)
exportCSV = Data.ExportCSV(filePath=string, data=name)

# group: Select Categories
categories_2 = Categories()  # nothing selected
# note: Add/Remove categories depending on project.
categories_3 = Categories(index=599)
categories_4 = Categories(index=408)
categories_5 = Categories(index=208)
categories_6 = Categories()  # nothing selected
categories_7 = Categories()  # nothing selected
categories_8 = Categories()  # nothing selected
categories_9 = Categories()  # nothing selected

all_elements_of_category_2 = ElementsOfCategory(Category=categories_2)
name_2 = Element.Name(element=all_elements_of_category_2)
string_2 = StringInput("C:\_DegreeProject-Spring19-AndreWisen\190130 - Revit Collision\ids2.csv")
all_elements_of_category_3 = ElementsOfCategory(Category=categories_3)
name_3 = Element.Name(element=all_elements_of_category_3)
all_elements_of_category_4 = ElementsOfCategory(Category=categories_4)
name_4 = Element.Name(element=all_elements_of_category_4)
all_elements_of_category_5 = ElementsOfCategory(Category=categories_5)
name_5 = Element.Name(element=all_elements_of_category_5)

# group: EDIT LIST
# note: N.B. Make sure you connect the nodes.
join = List.Join(list0=name_3, list1=name_4, list2=name_5)

exportCSV_2 = Data.ExportCSV(filePath=string_2, data=join)
all_elements_of_category_6 = ElementsOfCategory(Category=categories_6)
name_6 = Element.Name(element=all_elements_of_category_6)
all_elements_of_category_7 = ElementsOfCategory(Category=categories_7)
name_7 = Element.Name(element=all_elements_of_category_7)
all_elements_of_category_8 = ElementsOfCategory(Category=categories_8)
name_8 = Element.Name(element=all_elements_of_category_8)
all_elements_of_category_9 = ElementsOfCategory(Category=categories_9)
name_9 = Element.Name(element=all_elements_of_category_9)
