# Dynamo graph DynamoLightScrip01-1.dyn (Dynamo 2.0.2.6826)

categories = Categories(index=252)
all_elements_of_category = ElementsOfCategory(Category=categories)
watch = Watch(all_elements_of_category)
number = DoubleInput(0)
getItemAtIndex = List.GetItemAtIndex(list=all_elements_of_category, index=number)
watch_2 = Watch(getItemAtIndex)
parameters = Element.Parameters(element=getItemAtIndex)

# group: DEBUGG
code_block = CodeBlock { ["Lamp"]; }

getFamily = FamilyInstance.GetFamily(familyInstance=getItemAtIndex)
name = FamilyType.Name(familyType=getItemAtIndex)
byFamilyAndName = FamilyType.ByFamilyAndName(family=getFamily, name=name)
code_block_2 = CodeBlock { ["Emit from Rectangle Width"]; }
getParameterValueByName = Element.GetParameterValueByName(element=byFamilyAndName, parameterName=code_block_2, lacing=CrossProduct)
watch_3 = Watch(getParameterValueByName)
parameters_2 = Element.Parameters(element=byFamilyAndName)
watch_4 = Watch(parameters_2)
