# Dynamo graph ReadJSON.dyn (Dynamo 2.0.2.6826)

# group: Filepath
# note: N.B. Be sure to add a backslash at the end of the string.
# E.g. "C:\Users\localusers\Revit\"
directory = StringInput("C:\GitHub\AI281X-DegreeProject\v2\CSV-Files\")
# note: E.g. "myJSON.txt"
filename_inc_ext = StringInput("deltaOut.txt")
# note: E.g. "C:\Users\localusers\Revit\myJSON.txt"
filepath = String.Concat(string0=directory, string1=filename_inc_ext)
fromJsonFile = JsonData.Utilities.Read.FromJsonFile(filepath=filepath)

# group: Get Element(s) by Id
keys = JsonData.Elements.JsonObject.Keys(jsonObject=fromJsonFile)
toNumber = String.ToNumber(str=keys, lacing=Longest)
code_block = CodeBlock(id=toNumber) { Revit.Elements.ElementSelector.ByElementId(id); }

# group: Get Metadata
getValueByKey = JsonObject.GetValueByKey(jsonObject=fromJsonFile, keys=keys, Nesting=true, Option="None")
watch = Watch(getValueByKey)

# group: Get Location Coordinates
string = StringInput("Location")
getValueByKey_2 = JsonObject.GetValueByKey(jsonObject=getValueByKey, keys=string, Nesting=true, Option="None")
firstItem = List.FirstItem(list=getValueByKey_2)

# group: Convert Coordinates to (delta) Vector
number = DoubleInput(0)
getItemAtIndex = List.GetItemAtIndex(list=firstItem, index=number)
toNumber_2 = String.ToNumber(str=getItemAtIndex)
number_2 = DoubleInput(1)
getItemAtIndex_2 = List.GetItemAtIndex(list=firstItem, index=number_2)
toNumber_3 = String.ToNumber(str=getItemAtIndex_2)
number_3 = DoubleInput(2)
getItemAtIndex_3 = List.GetItemAtIndex(list=firstItem, index=number_3)
toNumber_4 = String.ToNumber(str=getItemAtIndex_3)
byCoordinates = Vector.ByCoordinates(x=toNumber_2, y=toNumber_3, z=toNumber_4)

# group: Translate Vectors
getLocation = Element.GetLocation(element=code_block)
add = Point.Add(point=getLocation, vectorToAdd=byCoordinates)
watch_2 = Watch(add)

# group: Get Rotation
string_2 = StringInput("Rotation")
getValueByKey_3 = JsonObject.GetValueByKey(jsonObject=getValueByKey, keys=string_2, Nesting=true, Option="None")
firstItem_2 = List.FirstItem(list=getValueByKey_3)

# group: Get Location Coordinates
string_3 = StringInput("Intensity")
getValueByKey_4 = JsonObject.GetValueByKey(jsonObject=getValueByKey, keys=string_3, Nesting=true, Option="None")

setLocation = Element.SetLocation(element=code_block, geometry=add)
number_4 = DoubleInput(0)
setRotation = FamilyInstance.SetRotation(familyInstance=code_block, degree=number_4)
