# Dynamo graph ExportCollisionIDs.dyn (Dynamo 2.0.2.6826)

# group: 1. Select Categories
categories = Categories()  # nothing selected
# note: Add/Remove categories depending on project.
categories_2 = Categories(index=599)
categories_3 = Categories(index=408)
categories_4 = Categories(index=208)
categories_5 = Categories()  # nothing selected
categories_6 = Categories()  # nothing selected
categories_7 = Categories()  # nothing selected
categories_8 = Categories()  # nothing selected

# group: Selects all elements of category
all_elements_of_category = ElementsOfCategory(Category=categories)
name = Element.Name(element=all_elements_of_category)
all_elements_of_category_2 = ElementsOfCategory(Category=categories_2)
name_2 = Element.Name(element=all_elements_of_category_2)
all_elements_of_category_3 = ElementsOfCategory(Category=categories_3)
name_3 = Element.Name(element=all_elements_of_category_3)
all_elements_of_category_4 = ElementsOfCategory(Category=categories_4)
name_4 = Element.Name(element=all_elements_of_category_4)
all_elements_of_category_5 = ElementsOfCategory(Category=categories_5)
name_5 = Element.Name(element=all_elements_of_category_5)
all_elements_of_category_6 = ElementsOfCategory(Category=categories_6)
name_6 = Element.Name(element=all_elements_of_category_6)
all_elements_of_category_7 = ElementsOfCategory(Category=categories_7)
name_7 = Element.Name(element=all_elements_of_category_7)
all_elements_of_category_8 = ElementsOfCategory(Category=categories_8)
name_8 = Element.Name(element=all_elements_of_category_8)

# group: EDIT LIST
# note: N.B. Make sure you connect the nodes.
join = List.Join(list0=name_2, list1=name_3, list2=name_4)

# group: 2. Set PATH
PATH = StringInput("C:\GitHub\AI281X-DegreeProject\v3\DynamoForRevit")
exportCSV = Data.ExportCSV(filePath=PATH, data=join)
